# Grasshopper definition tool_2023.gh (Grasshopper 1.0.7)
# plug-ins: LadybugGrasshopper

# ----
# Create Structure
number_slider = Slider(13, range=0..20)
panel = Panel("""0
10
15
22
20
15
20
20
15""")
panel_2 = Panel("""0
10
10
10
10
10
10
12
10
10
10
10
10
10""")
pt = Point(Point(0, 0, 0))
line = Line(Line((0, 0, 0), (1, 0, 0)))
line_2 = Line(Line((0, 0, 0), (0, 1, 0)))
make_grid = GhPythonScript(
    sp=pt,
    span_x=panel_2,
    span_y=panel,
    xaxis=line,
    yaxis=line_2,
    height=number_slider,
    core=[Slider(1, range=0..10), Slider(1, range=0..10)])  # -> out, columns, beams_x, beams_y, cores; inputs span_x: list, span_y: list, core: list of Int32
# ---------- make_grid: Python ----------
import rhinoscriptsyntax as rs

from carbon_tool.functions import make_structure
reload(make_structure)
from carbon_tool.functions.make_structure import make_grid_structure


columns, beams_x, beams_y, cores = make_grid_structure(sp,
                                                       span_x,
                                                       span_y,
                                                       xaxis,
                                                       yaxis,
                                                       height,
                                                       core)
# ---------- end make_grid ----------
crv = Curve(<curve referenced from the Rhino model>)
trim_grid = GhPythonScript(polyline=crv, columns=make_grid.columns, beams_x=make_grid.beams_x, beams_y=make_grid.beams_y, cores=make_grid.cores)  # -> out, columns, beams_x, beams_y, cores; inputs polyline: list, columns: list, beams_x: list, beams_y: list, cores: list
# ---------- trim_grid: Python ----------
import rhinoscriptsyntax as rs

from carbon_tool.functions import make_structure
reload(make_structure)
from carbon_tool.functions.make_structure import trim_structure


columns, beams_x, beams_y, cores = trim_structure(polyline,
                                                  columns,
                                                  beams_x,
                                                  beams_y,
                                                  cores)
# ---------- end trim_grid ----------
num_floors_above = Slider(18, range=0..18)
building_type = ValueList({"Type 3", "Type 4A", "Type 4B", "Type 4C", "Type 5"}, selected="Type 4B")
beams_x = Curve(trim_grid.beams_x)
beams_y = Curve(trim_grid.beams_y)
columns = Curve(trim_grid.columns)
cores = Curve(trim_grid.cores)
composite_slab = BooleanToggle(True)
columns_2 = Curve(flatten(columns))
beams_x_2 = Curve(flatten(beams_x))
beams_y_2 = Curve(flatten(beams_y))
core = Curve(flatten(cores))

# ----
# Horizontal Shading Options
north_horizontal_shade_depth_ft = Slider(4, range=0..10)
south_horizontal_shade_depth_ft = Slider(2, range=0..10)
west_horizontal_shade_depth = Slider(1, range=0..10)
east_horizontal_shade_depth_ft = Slider(2, range=0..10)
north_horizontal_shades = Slider(0, range=0..10)
east_horizontal_shades = Slider(0, range=0..10)
south_horizontal_shades = Slider(0, range=0..10)
west_horizontal_shades = Slider(0, range=0..10)

# ----
# Vertical Shading Options
west_vertical_shade_depth_ft = Slider(1, range=0..10)
north_vertical_shade_depth_ft = Slider(1, range=0..10)
east_vertical_shade_depth_ft = Slider(1, range=0..10)
south_vertical_shade_depth_ft = Slider(1, range=0..10)
of_north_vertical_shades = Slider(0, range=0..10)
of_east_vertical_shades = Slider(0, range=0..10)
of_south_vertical_shades = Slider(0, range=0..10)
of_west_vertical_shades = Slider(0, range=0..10)

# ----
# Automated Exterior Shading Options
exterior_automated_shades_north = BooleanToggle(False)
exterior_automated_shades_east = BooleanToggle(False)
exterior_automated_shades_south = BooleanToggle(False)
exterior_automated_shades_west = BooleanToggle(False)

# ----
# WWR
west_wwr = Slider(0.4, range=0.1..0.9)
# Glazing/Solar
# Shading Options
north_wwr = Slider(0.4, range=0.1..0.9)
east_wwr = Slider(0.4, range=0.1..0.9)
south_wwr = Slider(0.4, range=0.1..0.9)

# ----
# INPUTS
# General
# Zone & Massing
# Information
# Building Name
name = Panel("test_building")

# ----
# Roof & Floor
# Conditions
floor_adiabatic = BooleanToggle(True)
roof_adiabatic = BooleanToggle(True)

# ----
# Custom Shading Devices
exterior_shades_brep = Brep()

# ----
# Zone Names
panel_3 = Panel("""north
east
south
west
core""")

# ----
# Zone Geometry
brep = Brep([<brep referenced from the Rhino model> x5])

# ----
# Context Buildings (shading)
context_buildings = Brep()

# ----
# Balconies
balconies = Brep()

# ----
# Run Simulation
folder_to_save_simulations = Panel("")
lb_falsestarttoggle = LBFalseStartToggle(False)
city = ValueList({"Seattle", "Los Angeles", "San Antonio", "Atlanta", "Milwaukee", "New York", "San Francisco", "Phoenix", "Miami"}, selected="Seattle")

# ----
# Carbon Results
number_slider_2 = Slider(0, range=0..10)
pick_csv_file = GhPythonScript(i=number_slider_2)  # -> out, file; inputs i: Int32
# ---------- pick_csv_file: Python ----------
__author__ = "tmendeze"


import carbon_tool
import os


files = []
for f in os.listdir(os.path.join(carbon_tool.TEMP)):
    if f.endswith('.obj'):
        files.append(f)

file = files[i]
# ---------- end pick_csv_file ----------
panel_4 = Panel(pick_csv_file.file)
pie_maker = GhPythonScript(filename=panel_4, num_years=Slider(30, range=0..30))  # -> out, embodied, operational, emb_v_op
# ---------- pie_maker: Python ----------
__author__ = "tmendeze"


from carbon_tool.functions import pie_maker
reload(pie_maker)
from carbon_tool.functions.pie_maker import make_pies

data = make_pies(filename, num_years)

embodied, operational, emb_v_op = data

#e = 'embodied {} kgCo2e/ft2'.format(round(embodied, 2))
#o = 'operational {} kgCo2e/ft2 yr'.format(round(operartional, 2))

#print(e)
#print(o)
# ---------- end pie_maker ----------
panel_5 = Panel(pie_maker.out)
# OUTPUTS
pie = PieChart(pie_maker.embodied)
pie_2 = PieChart(pie_maker.emb_v_op)
pie_3 = PieChart(pie_maker.operational)

# ----
# Wall Assembly
# Options
ext_insulation_thickness_in = Slider(1, range=0..12)
int_insulation = ValueList({"Fiberglass", "Cellulose", "None"}, selected="None")
interior_finish = ValueList({"Gyp"}, selected="Gyp")
ext_insulation = ValueList({"EPS", "Polyiso", "Rockwool"}, selected="Polyiso")
facade_cladding = ValueList({"Brick", "Fiber Cement", "Aluminum", "Wood"}, selected="Fiber Cement")
exterior_wall_framing = ValueList({"2x4 Wood Studs", "2x6 Wood Studs", "2x8 Wood Studs", "2x10 Wood Studs", "2x12 Wood Studs"}, selected="2x4 Wood Studs")

# ----
# Window Properties
shgc_east_windows = Slider(0.35, range=0.1..0.8)
shgc_south_windows = Slider(0.35, range=0.1..0.8)
shgc_north_windows = Slider(0.35, range=0.1..0.8)
shgc_west_windows = Slider(0.35, range=0.1..0.8)
of_panes = ValueList({"Double": "double", "Triple": "triple"}, selected="Double")

building = GhPythonScript(
    name=name,
    zone_breps=brep,
    znames=panel_3,
    is_roof_adiabatic=roof_adiabatic,
    is_floor_adiabatic=floor_adiabatic,
    north_wwr=north_wwr,
    east_wwr=east_wwr,
    south_wwr=south_wwr,
    west_wwr=west_wwr,
    north_horizontal_shade_depth=north_horizontal_shade_depth_ft,
    east_horizontal_shade_depth=east_horizontal_shade_depth_ft,
    south_horizontal_shade_depth=south_horizontal_shade_depth_ft,
    west_horizontal_shade_depth=west_horizontal_shade_depth,
    north_horizontal_num_shades=north_horizontal_shades,
    east_horizontal_num_shades=east_horizontal_shades,
    south_horizontal_num_shades=south_horizontal_shades,
    west_horizontal_num_shades=west_horizontal_shades,
    north_vertical_shade_depth=north_vertical_shade_depth_ft,
    east_vertical_shade_depth=east_vertical_shade_depth_ft,
    south_vertical_shade_depth=south_vertical_shade_depth_ft,
    west_vertical_shade_depth=west_vertical_shade_depth_ft,
    north_vertical_num_shades=of_north_vertical_shades,
    east_vertical_num_shades=of_east_vertical_shades,
    south_vertical_num_shades=of_south_vertical_shades,
    west_vertical_num_shades=of_west_vertical_shades,
    north_automated_shades=exterior_automated_shades_north,
    east_automated_shades=exterior_automated_shades_east,
    south_automated_shades=exterior_automated_shades_south,
    west_automated_shades=exterior_automated_shades_west,
    glazing_type=of_panes,
    shgc_n=shgc_north_windows,
    shgc_e=shgc_east_windows,
    shgc_s=shgc_south_windows,
    shgc_w=shgc_west_windows,
    custom_shades=exterior_shades_brep,
    cladding=facade_cladding,
    exterior_insulation_material=ext_insulation,
    exterior_insulation_thickness=ext_insulation_thickness_in,
    interior_insulation_material=int_insulation,
    exterior_wall_framing=exterior_wall_framing,
    interior_finish=interior_finish,
    city=city,
    out_path=folder_to_save_simulations,
    run_model=lb_falsestarttoggle,
    building_type=building_type,
    num_floors_above=num_floors_above,
    composite_slab=composite_slab,
    columns=columns_2,
    beams_x=beams_x_2,
    beams_y=beams_y_2,
    cores=core,
    context_buildings=context_buildings,
    balconies=balconies)  # -> out, building; inputs zone_breps: list, znames: list, custom_shades: list, columns: list, beams_x: list, beams_y: list, cores: list, context_buildings: list, balconies: list
# ---------- building: Python ----------
import rhinoscriptsyntax as rs
import datetime

from carbon_tool.datastructures import building
reload(building)
from carbon_tool.datastructures.building import Building

wwrs = {'north': north_wwr,
        'east': east_wwr,
        'south':south_wwr,
        'west': west_wwr}

shades = {'north':{'horizontal':{'depth': north_horizontal_shade_depth,
                                 'num'  : north_horizontal_num_shades},
                   'vertical':{'depth': north_vertical_shade_depth,
                                 'num'  : north_vertical_num_shades}},
          'east':{'horizontal':{'depth': east_horizontal_shade_depth,
                                 'num'  : east_horizontal_num_shades},
                   'vertical':{'depth': east_vertical_shade_depth,
                                 'num'  : east_vertical_num_shades}},                    
          'south':{'horizontal':{'depth': south_horizontal_shade_depth,
                                 'num'  : south_horizontal_num_shades},
                   'vertical':{'depth': south_vertical_shade_depth,
                                 'num'  : south_vertical_num_shades}},                       
          'west':{'horizontal':{'depth': west_horizontal_shade_depth,
                                 'num'  : west_horizontal_num_shades},
                   'vertical':{'depth': west_vertical_shade_depth,
                                 'num'  : west_vertical_num_shades}}}

automated_shades = {'north': north_automated_shades,
                    'east': east_automated_shades,
                    'south': south_automated_shades,
                    'west': west_automated_shades}

shgc = {'north': shgc_n,'east': shgc_e,'south': shgc_s,'west': shgc_w}

columns = [[list(rs.CurveStartPoint(col)), list(rs.CurveEndPoint(col))] for col in columns]
beams_x = [[list(rs.CurveStartPoint(beam)), list(rs.CurveEndPoint(beam))] for beam in beams_x]
beams_y = [[list(rs.CurveStartPoint(beam)), list(rs.CurveEndPoint(beam))] for beam in beams_y]
cores = [rs.PolylineVertices(core) for core in cores]

if run_model:
    time = datetime.datetime.now().strftime('%Y%m%d%H%M%S')
    name_ = '{}_{}'.format(name, time)
    #name_ = name

else:
    name_=name


building = Building.from_gh(name_,
                            zone_breps,
                            znames,
                            is_roof_adiabatic,
                            is_floor_adiabatic,
                            wwrs,
                            shades,
                            automated_shades,
                            glazing_type,
                            shgc,
                            custom_shades,
                            cladding,
                            exterior_insulation_material,
                            exterior_insulation_thickness,
                            interior_insulation_material,
                            exterior_wall_framing,
                            interior_finish,
                            city,
                            out_path,
                            run_model,
                            building_type,
                            num_floors_above,
                            composite_slab,
                            columns,
                            beams_x,
                            beams_y,
                            cores,
                            context_buildings,
                            balconies)
# ---------- end building ----------
panel_6 = Panel(building.out)
embodied = GhPythonScript(building=building.building)  # -> out, embodied_pie, total_embodied, embodied_ft2, building, envelope_report, slab_report, str_report, surface_to_volume, zone_areas
# ---------- embodied: Python ----------
__author__ = "tmendeze"

import rhinoscriptsyntax as rs

from carbon_tool.functions import pie_maker
reload(pie_maker)
from carbon_tool.functions.pie_maker import make_emb_pie

building.compute_structure_embodied()
building.compute_envelope_embodied()

embodied_pie, total_embodied, embodied_ft2 = make_emb_pie(building)

envelope_report = building.envelope.env_strings
slab_report = building.structure.slab_strings
str_report = [building.structure.beam_string]
str_report.append(building.structure.col_string)
surface_to_volume = building.surface_to_volume()
zone_areas = building.zone_areas()
# ---------- end embodied ----------
panel_7 = Panel(embodied.out)
panel_8 = Panel(embodied.zone_areas)
panel_9 = Panel(embodied.surface_to_volume)

draw_structure = GhPythonScript(building=embodied.building)  # -> out, slabs, columns, beams, cores
# ---------- draw_structure: Python ----------
__author__ = "tmendeze"

import rhinoscriptsyntax as rs

slabs, columns, beams, cores = building.draw_structure()
# ---------- end draw_structure ----------
brep_2 = Brep(draw_structure.cores)
brep_3 = Brep(draw_structure.slabs)
brep_4 = Brep(draw_structure.beams)

panel_10 = Panel(embodied.envelope_report)
panel_11 = Panel(embodied.slab_report)
panel_12 = Panel(embodied.str_report)
# COMPUTATION
panel_13 = Panel(draw_structure.out)
brep_5 = Brep(draw_structure.columns)
pie_4 = PieChart(embodied.embodied_pie)
kg_co2e_ft2 = Panel(embodied.embodied_ft2)
kg_co2e = Panel(embodied.total_embodied)
operational = Operational(building=embodied.building)  # -> wall_r_value, window_u_factor, model_2, sql, out, heating, cooling, lighting

wall_r_value = Panel(operational.wall_r_value)

window_u_factor = Panel(operational.window_u_factor)

# ----
# View Zones
vizbytype = HBVisualizeByType(hb_objs=operational.model_2)  # -> walls, interior_walls, roofs, ceilings, exterior_floors, interior_floors, air_walls, apertures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; plug-in component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

# ----
# Energy Model &
# SQL file
model = Data(operational.model_2)
sql = Data(operational.sql)

panel_14 = Panel(operational.out)

# ----
# Annual EUI
# *run simulation toggle
# needs to be "on" to see results
imperial_units = BooleanToggle(True)
eui = HBEndUseIntensity(sql=sql, ip=imperial_units)  # -> eui, eui_end_use, end_uses, gross_floor; plug-in component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
total_eui_kbtu_sf_year = Panel(eui.eui)
end_uses = Panel(eui.end_uses)
end_use_eui_kbtu_sf_year = Panel(eui.eui_end_use)

# ----
# View Zones
# Turn Preview On of
# "VizByType" to see
# thermal zones in Rhino:
# Turn Preview On of
# "LabelRooms" to see
# label zone names in
# Rhino:
vizbytype_2 = HBVisualizeByType(hb_objs=model)  # -> walls, interior_walls, roofs, ceilings, exterior_floors, interior_floors, air_walls, apertures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; disabled; plug-in component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
labelrooms = HBLabelRooms(rooms_model=flatten(model))  # -> label_text, base_pts, labels, wire_frame; disabled; plug-in component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

# ----
# Energy Results Output
# only available when
# run simulation toggle
# is on
roomenergyresult = HBReadRoomEnergyResult(sql=sql)  # -> cooling, heating, lighting, electric_equip, gas_equip, process, hot_water, fan_electric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; disabled; plug-in component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

# ----
# Lighting Results
normbyflr = HBNormalizeByFloorArea(data=roomenergyresult.lighting, model=model)  # -> total_data, room_data; disabled; plug-in component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
toip = LBToIP(data_si=normbyflr.total_data)  # -> data_ip; disabled; plug-in component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
panel_15 = Panel("total")  # disabled
timeop = LBTimeIntervalOperation(data=toip, operation=panel_15)  # -> daily, monthly, mon_per_hr; disabled; plug-in component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

# ----
# Cooling Results
normbyflr_2 = HBNormalizeByFloorArea(data=roomenergyresult.cooling, model=model)  # -> total_data, room_data; disabled; plug-in component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
toip_2 = LBToIP(data_si=normbyflr_2.total_data)  # -> data_ip; disabled; plug-in component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
panel_16 = Panel("total")  # disabled
timeop_2 = LBTimeIntervalOperation(data=toip_2, operation=panel_16)  # -> daily, monthly, mon_per_hr; disabled; plug-in component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

# ----
# Heating Results
normbyflr_3 = HBNormalizeByFloorArea(data=roomenergyresult.heating, model=model)  # -> total_data, room_data; disabled; plug-in component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
toip_3 = LBToIP(data_si=normbyflr_3.total_data)  # -> data_ip; disabled; plug-in component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
panel_17 = Panel("total")  # disabled
timeop_3 = LBTimeIntervalOperation(data=toip_3, operation=panel_17)  # -> daily, monthly, mon_per_hr; disabled; plug-in component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

# ----
# Electric Equipment
normbyflr_4 = HBNormalizeByFloorArea(data=roomenergyresult.electric_equip, model=model)  # -> total_data, room_data; disabled; plug-in component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
toip_4 = LBToIP(data_si=normbyflr_4.total_data)  # -> data_ip; disabled; plug-in component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
panel_18 = Panel("total")  # disabled
timeop_4 = LBTimeIntervalOperation(data=toip_4, operation=panel_18)  # -> daily, monthly, mon_per_hr; disabled; plug-in component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

# ----
# Hourly Annual Energy Use Results
# plug in data type from sql (heating,
# cooling, lighting, or equipment)
# into "data" input into NormByFlr
# component
# Turn Preview On for
# "HourlyPlot" to see
# results in Rhino:
# input min and max for legend
normbyflr_5 = HBNormalizeByFloorArea(data=roomenergyresult.cooling, model=model)  # -> total_data, room_data; disabled; plug-in component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
legendpar = LBLegendParameters()  # -> leg_par; disabled; plug-in component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
toip_5 = LBToIP(data_si=normbyflr_5.room_data)  # -> data_ip; disabled; plug-in component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
hourlyplot = LBHourlyPlot(data=toip_5, legend_par=legendpar)  # -> out, mesh, legend, borders, labels, title, vis_set; disabled; plug-in component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

# ----
# Monthly EUI Results
# Turn Preview On for
# "MonthlyChart" to see
# results in Rhino:
# input min and max for legend
legendpar_2 = LBLegendParameters()  # -> leg_par; disabled; plug-in component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
boolean_toggle = BooleanToggle(True)  # disabled
monthlychart = LBMonthlyChart(
    data=[timeop_3.monthly, timeop_2.monthly, timeop.monthly, timeop_4.monthly],
    stack=boolean_toggle,
    legend_par=legendpar_2)  # -> out, data_mesh, data_lines, col_lines, legend, borders, labels, y_title, title, vis_set; disabled; plug-in component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

# ----
# Color Rooms with Energy Results
# plug in data type from sql (heating,
# cooling, lighting, or equipment)
# into "data" input into ToIP
# component
# Turn Preview On for
# "ColorRooms" to see
# results in Rhino:
# choose month from slider,
# or disconnect slider to look
# at annual results
# input min and max for legend
month = Slider(3, range=1..12)  # disabled
boolean_toggle_2 = BooleanToggle(True)  # disabled
analysisperiod = LBAnalysisPeriod(start_month=month, start_day=1, start_hour=0, end_month=month)  # -> period, hoys, dates; disabled; plug-in component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
toip_6 = LBToIP(data_si=roomenergyresult.heating)  # -> data_ip; disabled; plug-in component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
legendpar_3 = LBLegendParameters()  # -> leg_par; disabled; plug-in component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
colorrooms = HBColorRooms(
    data=flatten(toip_6),
    rooms_model=flatten(model),
    norm_by_flr=boolean_toggle_2,
    period=analysisperiod.period,
    legend_par=legendpar_3)  # -> readMe, mesh, wire_frame, legend, title, rooms, colors, values, vis_set; disabled; plug-in component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

# ==== cluster Operational
building = ClusterInput()
building_op_out = GhPythonScript(building=building)  # -> out, name, breps, znames, is_roof_adiabatic, is_floor_adiabatic, north_wwr, east_wwr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
# ---------- building_op_out: Python ----------
zone_breps                    = building.zone_breps                   
znames                        = building.znames                       
is_roof_adiabatic             = building.is_roof_adiabatic            
is_floor_adiabatic            = building.is_floor_adiabatic           
wwrs                          = building.wwrs                         
shades                        = building.shades
automated_shades              = building.automated_shades
glazing_u                     = building.glazing_u                    
shgc                          = building.shgc                         
custom_shades                 = building.custom_shades                
cladding                      = building.cladding                     
exterior_insulation_material  = building.exterior_insulation_material 
exterior_insulation_thickness = building.exterior_insulation_thickness
interior_insulation_material  = building.interior_insulation_material 
exterior_wall_framing         = building.exterior_wall_framing        
interior_finish               = building.interior_finish              
weather_file                  = building.weather_file                 
out_path                      = building.out_path                     
run_model                     = building.run_model                     


name = building.name

breps = [zone_breps[zname] for zname in building.znames]

north_wwr = wwrs['north']
east_wwr = wwrs['east']
south_wwr = wwrs['south']
west_wwr = wwrs['west']


north_horizontal_shade_depth = shades['north']['horizontal']['depth']
east_horizontal_shade_depth = shades['east']['horizontal']['depth']
south_horizontal_shade_depth = shades['south']['horizontal']['depth']
west_horizontal_shade_depth = shades['west']['horizontal']['depth']

north_horizontal_num_shades = shades['north']['horizontal']['num']
east_horizontal_num_shades = shades['east']['horizontal']['num']
south_horizontal_num_shades = shades['south']['horizontal']['num']
west_horizontal_num_shades = shades['west']['horizontal']['num']

north_vertical_shade_depth = shades['north']['vertical']['depth']
east_vertical_shade_depth = shades['east']['vertical']['depth']
south_vertical_shade_depth = shades['south']['vertical']['depth']
west_vertical_shade_depth = shades['west']['vertical']['depth']

north_vertical_num_shades = shades['north']['vertical']['num']
east_vertical_num_shades = shades['east']['vertical']['num']
south_vertical_num_shades = shades['south']['vertical']['num']
west_vertical_num_shades = shades['west']['vertical']['num']

north_automated_shades = automated_shades['north']
east_automated_shades = automated_shades['east']
south_automated_shades = automated_shades['south']
west_automated_shades = automated_shades['west']

shgc_n = shgc['north']
shgc_e = shgc['east']
shgc_s = shgc['south']
shgc_w = shgc['west']

context_buildings = building.context_buildings
balconies = building.balconies
# ---------- end building_op_out ----------
panel = Panel(building_op_out.out)
weather_file = Panel(building_op_out.weather_file)
folder_to_save_simulations = Panel(building_op_out.out_path)
exterior_shades_brep = Brep([building_op_out.custom_shades, building_op_out.context_buildings, building_op_out.balconies])
panel_2 = Panel(building_op_out.znames)
brep = Brep(building_op_out.breps)
panel_3 = Panel(building_op_out.exterior_wall_framing)
concatenate = Concatenate(Fragment_A=building_op_out.interior_insulation_material, Fragment_B=" ", A=panel_3)
hb_climate_zones = HBClimateZones({"1 - Very Hot": "1", "2 - Hot": "2", "3 - Warm": "3", "4 - Mixed": "4", "5 - Cool": "5", "6 - Cold": "6", "7 - Very Cold": "7", "8 - Subarctic": "8"}, selected="4 - Mixed")
hb_building_programs = HBBuildingPrograms({"LargeOffice", "MediumOffice", "SmallOffice", "MidriseApartment", "HighriseApartment", "Retail", "StripMall", "PrimarySchool", "SecondarySchool", "SmallHotel", "LargeHotel", "Hospital", "Outpatient", "Laboratory", "Warehouse", "SuperMarket", "FullServiceRestaurant", "QuickServiceRestaurant", "Courthouse", "LargeDataCenterHighITE", "LargeDataCenterLowITE", "SmallDataCenterHighITE", "SmallDataCenterLowITE"}, selected="MidriseApartment")
panel_4 = Panel(concatenate)
constrsetclimate = HBConstructionSetByClimate(climate_zone=hb_climate_zones, constr_type="WoodFramed")  # -> constr_set; plug-in component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
roomsolid = HBRoomFromSolid(geo=flatten(brep), name=panel_2, constr_set=constrsetclimate, program=hb_building_programs, conditioned=True)  # -> out, rooms; plug-in component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
read_material = GhPythonScript(building=building_op_out.building, material_name=building_op_out.cladding)  # -> out, r_per_in, embodied_carbon, type, thickness_in, thickness_m, conductivity, density, sp_heat, r_value
# ---------- read_material: Python ----------
import rhinoscriptsyntax as rs
import sys

import carbon_tool

from carbon_tool.functions import read_materials

material = read_materials(material_name)

print(material.keys())


if material_name == building.exterior_insulation_material:
    thickness_in = building.exterior_insulation_thickness
    
else:
    thickness_in = material["thickness_in"]

thickness_m = thickness_in / 39.37

r_per_in = material["r_per_in"]
embodied_carbon = material["embodied_carbon"]
type = material["mtype"]
density = material["density"]
sp_heat = material["sp_heat"]
#thickness_in = material["thickness_in"]
#thickness_m = material["thickness_m"]
r_value = material["r_value"]
conductivity = material["conductivity"]
# ---------- end read_material ----------
read_material_2 = GhPythonScript(building=building_op_out.building, material_name=panel_4)  # -> out, r_per_in, embodied_carbon, type, thickness_in, thickness_m, conductivity, density, sp_heat, r_value
# ---------- read_material_2: Python ----------
import rhinoscriptsyntax as rs
import sys

import carbon_tool

from carbon_tool.functions import read_materials

material = read_materials(material_name)

print(material.keys())


if material_name == building.exterior_insulation_material:
    thickness_in = building.exterior_insulation_thickness
    
else:
    thickness_in = material["thickness_in"]

r_per_in = material["r_per_in"]
embodied_carbon = material["embodied_carbon"]
type = material["mtype"]
density = material["density"]
sp_heat = material["sp_heat"]
#thickness_in = material["thickness_in"]
thickness_m = material["thickness_m"]
r_value = material["r_value"]
conductivity = material["conductivity"]
# ---------- end read_material_2 ----------
read_material_3 = GhPythonScript(building=building_op_out.building, material_name=building_op_out.exterior_insulation_material)  # -> out, r_per_in, embodied_carbon, type, thickness_in, thickness_m, conductivity, density, sp_heat, r_value; same code as read_material
read_material_4 = GhPythonScript(building=building_op_out.building, material_name=building_op_out.interior_finish)  # -> out, r_per_in, embodied_carbon, type, thickness_in, thickness_m, conductivity, density, sp_heat, r_value; same code as read_material
panel_5 = Panel(read_material_2.r_value)
solveadj = HBSolveAdjacency(rooms=flatten(roomsolid.rooms), run=Toggle(True))  # -> out, adj_rooms; plug-in component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

# ----
# Facade Material
thickness_m = Panel(read_material.thickness_m)
conductivity_w_m_k = Panel(read_material.conductivity)
density_kg_m3 = Panel(read_material.density)
specific_heat_j_kg_k = Panel(read_material.sp_heat)

# ----
# Exterior Insulation
r_per_inch_f_ft2_hr_btu_in = Panel(read_material_3.r_per_in)
thickness_in = Panel(building_op_out.exterior_insulation_thickness)

r_value_f_ft2_hr_btu = Panel(read_material_2.r_value)

thickness_m_2 = Panel(read_material_4.thickness_m)
conductivity_w_m_k_2 = Panel(read_material_4.conductivity)
specific_heat_j_kg_k_2 = Panel(read_material_4.sp_heat)
density_kg_m3_2 = Panel(read_material_4.density)

adiabaticbytype = HBAdiabaticByType(
    hb_objs=flatten(solveadj.adj_rooms),
    roofs=building_op_out.is_roof_adiabatic,
    exposed_floors=building_op_out.is_floor_adiabatic)  # -> hb_objs; plug-in component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
facparam = HBFacadeParameters(
    north=building_op_out.north_wwr,
    east=building_op_out.east_wwr,
    south=building_op_out.south_wwr,
    west=building_op_out.west_wwr)  # -> fac_par; plug-in component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
multiplication = Multiplication(A=r_per_inch_f_ft2_hr_btu_in, B=thickness_in)
units = LBUnitConverter(values=multiplication, from_u="h-ft2-F/Btu", to_u="m2-K/W")  # -> all_u, values; plug-in component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
aperturesbyratio = HBAperturesByRatio(hb_objs=flatten(adiabaticbytype), ratio=facparam)  # -> out, hb_objs; plug-in component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
units_2 = LBUnitConverter(values=r_value_f_ft2_hr_btu, from_u="h-ft2-F/Btu", to_u="m2-K/W")  # -> all_u, values; plug-in component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
facparam_2 = HBFacadeParameters(
    north=building_op_out.north_horizontal_shade_depth,
    east=building_op_out.east_horizontal_shade_depth,
    south=building_op_out.south_horizontal_shade_depth,
    west=building_op_out.west_horizontal_shade_depth)  # -> fac_par; plug-in component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
facparam_3 = HBFacadeParameters(
    north=building_op_out.north_horizontal_num_shades,
    east=building_op_out.east_horizontal_num_shades,
    south=building_op_out.south_horizontal_num_shades,
    west=building_op_out.west_horizontal_num_shades)  # -> fac_par; plug-in component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
# Exterior Insulation
opaquematnomass = HBOpaqueMaterialNoMass(name="exterior_insulatoin", r_value=units.values)  # -> flatten(mat); plug-in component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
# Air Gap
searchmats = HBSearchMaterials(keywords="generic wall gap")  # -> flatten(opaque_mats), window_mats; plug-in component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
# Facade Material
opaquemat = HBOpaqueMaterial(
    name="facade_material",
    thickness=thickness_m,
    conductivity=conductivity_w_m_k,
    density=density_kg_m3,
    spec_heat=specific_heat_j_kg_k)  # -> flatten(mat); plug-in component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
equality = Equality(FirstNumber=thickness_in, SecondNumber=0)  # -> Equality, Inequality
facparam_4 = HBFacadeParameters(north=building_op_out.shgc_n, east=building_op_out.shgc_e, south=building_op_out.shgc_s, west=building_op_out.shgc_w)  # -> fac_par; plug-in component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
units_3 = LBUnitConverter(values=building_op_out.glazing_u, from_u="Btu/h-ft2-F", to_u="W/m2-K")  # -> all_u, values; plug-in component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
opaquematnomass_2 = HBOpaqueMaterialNoMass(name="exterior_wall_framing", r_value=units_2.values)  # -> flatten(mat); plug-in component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
opaquemat_2 = HBOpaqueMaterial(
    name="interior_finish",
    thickness=thickness_m_2,
    conductivity=conductivity_w_m_k_2,
    density=density_kg_m3_2,
    spec_heat=specific_heat_j_kg_k_2)  # -> flatten(mat); plug-in component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
louvershades = HBLouverShades(hb_objs=flatten(aperturesbyratio.hb_objs), depth=facparam_2, shade_count=facparam_3)  # -> readMe, hb_objs; plug-in component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
windowmat = HBWindowMaterial(u_factor=units_3.values, shgc=graft(facparam_4))  # -> simplify(mat); plug-in component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
stream_filter = StreamFilter(Gate=equality.Inequality, Stream1=opaquematnomass)  # -> flatten(Stream)
facparam_5 = HBFacadeParameters(
    north=building_op_out.north_vertical_shade_depth,
    east=building_op_out.east_vertical_shade_depth,
    south=building_op_out.south_vertical_shade_depth,
    west=building_op_out.west_vertical_shade_depth)  # -> fac_par; plug-in component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
facparam_6 = HBFacadeParameters(
    north=building_op_out.north_vertical_num_shades,
    east=building_op_out.east_vertical_num_shades,
    south=building_op_out.south_vertical_num_shades,
    west=building_op_out.west_vertical_num_shades)  # -> fac_par; plug-in component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
windowconstr = HBWindowConstruction(materials=windowmat)  # -> constr; plug-in component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
thickness_shade_m = Slider(0.0008, range=0..0.001)
transmittance = Slider(0.1, range=0..0.1)
louvershades_2 = HBLouverShades(hb_objs=flatten(louvershades.hb_objs), depth=facparam_5, shade_count=facparam_6, vertical=Toggle(True))  # -> readMe, hb_objs; plug-in component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
w_m2_for_exterior_shade_deployment = Slider(25, range=0..100)
control_type = Slider(1, range=0..1)
shademat = HBShadeMaterial(thickness=thickness_shade_m, transmittance=transmittance)  # -> mat; plug-in component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
larger_than = LargerThan(FirstNumber=facparam_6, SecondNumber=0)  # -> LargerThan, OrEqualTo
facparam_7 = HBFacadeParameters(
    north=building_op_out.north_vertical_shade_depth,
    east=building_op_out.east_vertical_shade_depth,
    south=building_op_out.south_vertical_shade_depth,
    west=building_op_out.west_vertical_shade_depth)  # -> fac_par; plug-in component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
boolean_toggle = BooleanToggle(True)
windowconstrshd = HBWindowConstructionShade(
    win_constr=windowconstr,
    shd_material=shademat,
    shd_location="Exterior",
    control_type=control_type,
    setpoint=w_m2_for_exterior_shade_deployment)  # -> constr; plug-in component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
opaqueconstr = HBOpaqueConstruction(materials=[opaquemat, searchmats.opaque_mats, stream_filter, opaquematnomass_2, opaquemat_2])  # -> constr; plug-in component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
explode_tree = ExplodeTree(Data=windowconstr)  # -> Branch0, Branch1, Branch2, Branch3
louvershades_3 = HBLouverShades(
    hb_objs=flatten(louvershades_2.hb_objs),
    depth=facparam_7,
    shade_count=larger_than.LargerThan,
    vertical=boolean_toggle,
    flip_start=boolean_toggle)  # -> readMe, hb_objs; plug-in component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
explode_tree_2 = ExplodeTree(Data=windowconstrshd)  # -> Branch0, Branch1, Branch2, Branch3
panel_6 = Panel(opaqueconstr)
stream_filter_2 = StreamFilter(Gate=building_op_out.south_automated_shades, Stream0=explode_tree.Branch2, Stream1=explode_tree_2.Branch2)
stream_filter_3 = StreamFilter(Gate=building_op_out.east_automated_shades, Stream0=explode_tree.Branch1, Stream1=explode_tree_2.Branch1)
stream_filter_4 = StreamFilter(Gate=building_op_out.north_automated_shades, Stream0=explode_tree.Branch0, Stream1=explode_tree_2.Branch0)
stream_filter_5 = StreamFilter(Gate=building_op_out.west_automated_shades, Stream0=explode_tree.Branch3, Stream1=explode_tree_2.Branch3)
facparam_8 = HBFacadeParameters(north=stream_filter_4, east=stream_filter_3, south=stream_filter_2, west=stream_filter_5)  # -> fac_par; plug-in component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
applywindowconstr = HBApplyWindowConstruction(hb_objs=flatten(louvershades_3.hb_objs), constr=facparam_8)  # -> hb_objs; plug-in component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
applyopaqueconstr = HBApplyOpaqueConstruction(hb_objs=flatten(applywindowconstr), constr=opaqueconstr)  # -> hb_objs; plug-in component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
shade = HBShade(geo=exterior_shades_brep)  # -> out, shades; plug-in component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
daylightcontrol = HBApplyDaylightControl(rooms=flatten(applyopaqueconstr), ill_setpoint=Slider(500, range=0..1000))  # -> out, rooms; plug-in component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
null_item = NullItem(Item=shade.shades)  # -> NullFlags, InvalidFlags, Description
list_item = ListItem(List=null_item.NullFlags, Index=0, Wrap=True)
panel_7 = Panel(building_op_out.name)
stream_filter_6 = StreamFilter(Gate=list_item, Stream0=shade.shades)
model = HBModel(rooms=flatten(daylightcontrol.rooms), shades=flatten(stream_filter_6), name=panel_7)  # -> out, model; plug-in component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
modeltoosm = HBModelToOSM(
    model=model.model,
    epw_file=weather_file,
    folder=folder_to_save_simulations,
    write=building_op_out.run_model,
    run=building_op_out.run_model)  # -> out, jsons, osw, osm, idf, sql, zsz, rdd, html; plug-in component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
facesbytype = HBFacesByType(hb_objs=model.model)  # -> walls, interior_walls, roofs, ceilings, exterior_floors, interior_floors, air_walls, apertures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; plug-in component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
panel_8 = Panel(modeltoosm.idf)
model_2 = ClusterOutput(model.model)
sql = ClusterOutput(modeltoosm.sql)
hb_face_energy_attributes = HBFaceEnergyAttributes({"Construction": "properties.energy.construction.display_name", "Materials": "properties.energy.construction.layers", "Thickness [m]": "properties.energy.construction.thickness", "Density [kg/m2]": "properties.energy.construction.mass_area_density", "Heat Capacity [J/K-m2]": "properties.energy.construction.area_heat_capacity", "Construction R-Value [m2-K/W]": "properties.energy.construction.r_value", "Construction U-Value [W/m2-K]": "properties.energy.construction.u_value", "Construction U-Factor [W/m2-K]": "properties.energy.construction.u_factor", "Construction SHGC [Unshaded]": "properties.energy.construction.shgc", "R-Factor [m2-K/W]": "properties.energy.r_factor", "U-Factor [W/m2-K]": "properties.energy.u_factor", "SHGC [Unshaded]": "properties.energy.shgc", "Solar Transmitance [Unshaded]": "properties.energy.construction.solar_transmittance", "Visible Transmitance [Unshaded]": "properties.energy.construction.visible_transmittance", "Solar Reflectance [Outside]": "properties.energy.construction.outside_solar_reflectance", "Solar Reflectance [Inside]": "properties.energy.construction.inside_solar_reflectance", "Fraction Area Operable": "properties.energy.vent_opening.fraction_area_operable", "Fraction Height Operable": "properties.energy.vent_opening.fraction_height_operable", "Discharge Coefficient": "properties.energy.vent_opening.discharge_coefficient"}, selected="Construction U-Factor [W/m2-K]")
read_results = GhPythonScript(building=building_op_out.building, path=modeltoosm.html)  # -> out, heating, cooling, lighting
# ---------- read_results: Python ----------
__author__ = "time"

import rhinoscriptsyntax as rs
import os

from carbon_tool.functions import read_results
reload(read_results)
from carbon_tool.functions.read_results import read_results_file


if path:
    filepath = os.path.join(os.path.dirname(path), 'eplusout.eso')
    read_results_file(building, filepath)
    building.write_csvs()
    heating, cooling, lighting = building.report_operational()
    building.to_obj()
# ---------- end read_results ----------
hb_face_energy_attributes_2 = HBFaceEnergyAttributes({"Construction": "properties.energy.construction.display_name", "Materials": "properties.energy.construction.layers", "Thickness [m]": "properties.energy.construction.thickness", "Density [kg/m2]": "properties.energy.construction.mass_area_density", "Heat Capacity [J/K-m2]": "properties.energy.construction.area_heat_capacity", "Construction R-Value [m2-K/W]": "properties.energy.construction.r_value", "Construction U-Value [W/m2-K]": "properties.energy.construction.u_value", "Construction U-Factor [W/m2-K]": "properties.energy.construction.u_factor", "Construction SHGC [Unshaded]": "properties.energy.construction.shgc", "R-Factor [m2-K/W]": "properties.energy.r_factor", "U-Factor [W/m2-K]": "properties.energy.u_factor", "SHGC [Unshaded]": "properties.energy.shgc", "Solar Transmitance [Unshaded]": "properties.energy.construction.solar_transmittance", "Visible Transmitance [Unshaded]": "properties.energy.construction.visible_transmittance", "Solar Reflectance [Outside]": "properties.energy.construction.outside_solar_reflectance", "Solar Reflectance [Inside]": "properties.energy.construction.inside_solar_reflectance", "Fraction Area Operable": "properties.energy.vent_opening.fraction_area_operable", "Fraction Height Operable": "properties.energy.vent_opening.fraction_height_operable", "Discharge Coefficient": "properties.energy.vent_opening.discharge_coefficient"}, selected="Construction R-Value [m2-K/W]")
out = ClusterOutput(read_results.out)
heating = ClusterOutput(read_results.heating)
cooling = ClusterOutput(read_results.cooling)
lighting = ClusterOutput(read_results.lighting)
panel_9 = Panel(read_results.out)
lablefaces = HBLabelFaces(hb_objs=flatten(facesbytype.walls), attribute=hb_face_energy_attributes, sub_faces=Toggle(True))  # -> label_text, base_pts, labels, wire_frame; plug-in component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
lablefaces_2 = HBLabelFaces(hb_objs=flatten(facesbytype.walls), attribute=hb_face_energy_attributes_2)  # -> label_text, base_pts, labels, wire_frame; plug-in component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
list_item_2 = ListItem(List=lablefaces.label_text, Index=0, Wrap=True)
list_item_3 = ListItem(List=lablefaces_2.label_text, Index=0, Wrap=True)
units_4 = LBUnitConverter(values=list_item_2, from_u="W/m2-K", to_u="Btu/h-ft2-F")  # -> all_u, flatten(values); plug-in component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
units_5 = LBUnitConverter(values=list_item_3, from_u="m2-K/W", to_u="h-ft2-F/Btu")  # -> all_u, flatten(values); plug-in component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
evaluate = Evaluate(Expression="Format(\"{0:0.0}\", x)", x=units_5.values)
evaluate_2 = Evaluate(Expression="Format(\"{0:0.00}\", x)", x=units_4.values)
concatenate_2 = Concatenate(Fragment_A=evaluate, A=" ", Fragment_B="h-ft2-F/Btu")
concatenate_3 = Concatenate(Fragment_A=evaluate_2, A=" ", Fragment_B="Btu/h-ft2-F")
panel_10 = Panel(concatenate_2)
wall_r_value = ClusterOutput(concatenate_2)
window_u_factor = ClusterOutput(concatenate_3)
